# Dynamo graph INVERT DYNAMO.dyn (Dynamo 3.6.1.9956)

type = Object.Type()  # unwired: object
string = StringInput("_All Points")
current = Autodesk.AutoCAD.DynamoNodes.Document.Current()
getCogoPointGroupByName = Autodesk.Civil.DynamoNodes.CogoPointGroup.GetCogoPointGroupByName(name=string, document=current)
cogoPoints = Autodesk.Civil.DynamoNodes.CogoPointGroup.CogoPoints(cogoPointGroup=getCogoPointGroupByName)
rawDescription = Autodesk.Civil.DynamoNodes.CogoPoint.RawDescription(cogoPoint=cogoPoints)
string_2 = StringInput("INV")
contains = String.Contains(string=rawDescription, searchFor=string_2)
filterByBoolMask = List.FilterByBoolMask(list=cogoPoints, mask=contains)
list_create = List.Create(item0=filterByBoolMask.in)
string_3 = StringInput("MH")
contains_2 = String.Contains(string=rawDescription, searchFor=string_3)
string_4 = StringInput("CB")  # graph input
code_block = CodeBlock { true; }
contains_3 = String.Contains(string=rawDescription, searchFor=string_4, ignoreCase=code_block)
or_ = Or(bool0=contains_2, bool1=contains_3)
filterByBoolMask_2 = List.FilterByBoolMask(list=cogoPoints, mask=or_)
list_create_2 = List.Create(item0=filterByBoolMask_2.in)
watch = Watch(list_create_2)
elevation = Autodesk.Civil.DynamoNodes.CogoPoint.Elevation(cogoPoint=watch@L2)
watch_2 = Watch(elevation)
userDefinedProperties = Autodesk.Civil.DynamoNodes.CogoPoint.UserDefinedProperties(cogoPoint=filterByBoolMask.in)
keys = DesignScript.Builtin.Dictionary.Keys(dictionary=userDefinedProperties)
getNumber = String.GetNumber(string=rawDescription)
string_5 = StringInput("\"INVERT\"")
get_cogo_point_groups = CogoPointGroups()  # unwired: document
byPointsIndexGroups = Mesh.ByPointsIndexGroups(indexGroups=filterByBoolMask_2.in)  # unwired: points
easting = Autodesk.Civil.DynamoNodes.CogoPoint.Easting(cogoPoint=filterByBoolMask_2.in)
northing = Autodesk.Civil.DynamoNodes.CogoPoint.Northing(cogoPoint=filterByBoolMask_2.in)
byCoordinates = Point.ByCoordinates(x=easting, y=northing)
byPoints = Polygon.ByPoints(points=byCoordinates)
elevation_2 = Autodesk.Civil.DynamoNodes.CogoPoint.Elevation(cogoPoint=filterByBoolMask_2.in)
easting_2 = Autodesk.Civil.DynamoNodes.CogoPoint.Easting(cogoPoint=filterByBoolMask.in)
northing_2 = Autodesk.Civil.DynamoNodes.CogoPoint.Northing(cogoPoint=filterByBoolMask.in)
byCoordinates_2 = Point.ByCoordinates(x=easting_2, y=northing_2)
code_block_2 = CodeBlock { "INVERT"; }
valueAtKey = DesignScript.Builtin.Dictionary.ValueAtKey(dictionary=userDefinedProperties, key=code_block_2)
code_block_3 = CodeBlock { 5.0; 5.0; 1.0; 2; }
boolean = BoolSelector(false)
python_script = Python(IN[0]=byCoordinates, IN[1]=elevation_2, IN[2]=byCoordinates_2, IN[3]=valueAtKey, IN[4]=code_block_2, IN[5]=code_block_3.out0, IN[6]=code_block_3.out0, IN[7]=code_block_3.out2, IN[8]=code_block_3.out3, IN[9]=boolean)  # CPython3
# ---------- python_script.python (236 lines) ----------
"""Dynamo Python helper for HomeINV.

Inputs
IN[0] rim points: DesignScript points or Civil COGO points
IN[1] rim elevations: list[double]
IN[2] invert points: DesignScript points or Civil COGO points
IN[3] invert values: either depth values or UDP dictionaries
IN[4] UDP key: default "INVERT"
IN[5] leader dx: default 5.0
IN[6] leader dy: default 5.0
IN[7] text height: default 1.0
IN[8] precision: default 2
IN[9] create leaders: default False

Outputs
OUT[0] summary per rim
OUT[1] created multileader count
OUT[2] errors
"""

import math


def _flatten(value):
    if isinstance(value, (list, tuple)):
        out = []
        for item in value:
            out.extend(_flatten(item))
        return out
    return [value]


def _as_list(value):
    if value is None:
        return []
    if isinstance(value, (list, tuple)):
        return list(value)
    return [value]


def _maybe_float(value):
    if value is None:
        return None
    if isinstance(value, bool):
        return float(value)
    if isinstance(value, (int, float)):
        return float(value)
    if isinstance(value, str):
        cleaned = value.strip()
        if not cleaned:
            return None
        filtered = "".join(ch for ch in cleaned if ch in "0123456789.-")
        if filtered in ("", "-", ".", "-."):
            return None
        try:
            return float(filtered)
        except Exception:
            return None
    return None


def _dict_value(item, key):
    if item is None:
        return None
    if isinstance(item, dict):
        return item.get(key)
    if hasattr(item, "ValueAtKey"):
        try:
            return item.ValueAtKey(key)
        except Exception:
            pass
    if hasattr(item, "__getitem__"):
        try:
            return item[key]
        except Exception:
            pass
    return item


def _extract_depth(item, key):
    value = _dict_value(item, key)
    flat = _flatten(value)
    for candidate in flat:
        number = _maybe_float(candidate)
        if number is not None:
            return number
    return None


def _point_xyz(item):
    if item is None:
        return None
    if all(hasattr(item, axis) for axis in ("X", "Y")):
        z = getattr(item, "Z", 0.0)
        return (float(item.X), float(item.Y), float(z))
    if all(hasattr(item, axis) for axis in ("Easting", "Northing")):
        z = getattr(item, "Elevation", 0.0)
        return (float(item.Easting), float(item.Northing), float(z))
    if hasattr(item, "PointGeometry"):
        geom = item.PointGeometry
        if geom and all(hasattr(geom, axis) for axis in ("X", "Y")):
            z = getattr(geom, "Z", 0.0)
            return (float(geom.X), float(geom.Y), float(z))
    return None


def _format_number(value, precision):
    return ("{0:." + str(int(precision)) + "f}").format(float(value))


def _build_text(rim_elev, invert_elevs, precision):
    lines = ["RIM ELEV = " + _format_number(rim_elev, precision)]
    for elev in sorted(invert_elevs, reverse=True):
        lines.append("INVERT ELEV = " + _format_number(elev, precision))
    return lines


def _distance_xy(a, b):
    dx = a[0] - b[0]
    dy = a[1] - b[1]
    return dx * dx + dy * dy


rim_points = _as_list(IN[0] if len(IN) > 0 else None)
rim_elevs = _as_list(IN[1] if len(IN) > 1 else None)
invert_points = _as_list(IN[2] if len(IN) > 2 else None)
invert_values = _as_list(IN[3] if len(IN) > 3 else None)
udp_key = IN[4] if len(IN) > 4 and IN[4] else "INVERT"
leader_dx = float(IN[5]) if len(IN) > 5 and IN[5] is not None else 5.0
leader_dy = float(IN[6]) if len(IN) > 6 and IN[6] is not None else 5.0
text_height = float(IN[7]) if len(IN) > 7 and IN[7] is not None else 1.0
precision = int(IN[8]) if len(IN) > 8 and IN[8] is not None else 2
create_leaders = bool(IN[9]) if len(IN) > 9 else False

errors = []
rim_data = []

for idx, rim in enumerate(rim_points):
    xyz = _point_xyz(rim)
    elev = rim_elevs[idx] if idx < len(rim_elevs) else None
    elev = _maybe_float(elev if elev is not None else (xyz[2] if xyz else None))
    if xyz is None or elev is None:
        errors.append("Skipped rim index {0}: missing point or elevation.".format(idx))
        continue
    rim_data.append(
        {
            "index": idx,
            "xyz": xyz,
            "elev": elev,
            "invertElevs": [],
        }
    )

if not rim_data:
    OUT = ([], 0, errors + ["No valid rim points were supplied."])
else:
    for idx, inv_point in enumerate(invert_points):
        inv_xyz = _point_xyz(inv_point)
        depth_source = invert_values[idx] if idx < len(invert_values) else None
        depth = _extract_depth(depth_source, udp_key)
        if inv_xyz is None or depth is None:
            errors.append("Skipped invert index {0}: missing point or {1} value.".format(idx, udp_key))
            continue
        nearest = min(rim_data, key=lambda rim: _distance_xy(inv_xyz, rim["xyz"]))
        nearest["invertElevs"].append(nearest["elev"] - depth)

    summary = []
    for rim in rim_data:
        lines = _build_text(rim["elev"], rim["invertElevs"], precision)
        summary.append(
            {
                "rimPoint": rim["xyz"],
                "rimElevation": rim["elev"],
                "invertElevations": sorted(rim["invertElevs"], reverse=True),
                "textLines": lines,
                "mtextContents": "\\P".join(lines),
                "leaderPoint": (rim["xyz"][0] + leader_dx, rim["xyz"][1] + leader_dy, rim["xyz"][2]),
            }
        )

    created_count = 0

    if create_leaders:
        try:
            import clr

            for assembly_name in ("AcMgd", "AcDbMgd", "AcCoreMgd"):
                try:
                    clr.AddReference(assembly_name)
                except Exception:
                    pass

            from Autodesk.AutoCAD.ApplicationServices import Application
            from Autodesk.AutoCAD.DatabaseServices import BlockTableRecord, ContentType, MLeader, MText, OpenMode
            from Autodesk.AutoCAD.Geometry import Point3d

            doc = Application.DocumentManager.MdiActiveDocument
            db = doc.Database
            lock_doc = doc.LockDocument()
            tr = db.TransactionManager.StartTransaction()

            try:
                block_table = tr.GetObject(db.BlockTableId, OpenMode.ForRead)
                model_space = tr.GetObject(block_table[BlockTableRecord.ModelSpace], OpenMode.ForWrite)

                for item in summary:
                    mleader = MLeader()
                    mleader.SetDatabaseDefaults()
                    mleader.ContentType = ContentType.MTextContent

                    mtext = MText()
                    mtext.SetDatabaseDefaults()
                    mtext.TextHeight = text_height
                    mtext.Contents = item["mtextContents"]
                    mtext.Location = Point3d(
                        item["leaderPoint"][0], item["leaderPoint"][1], item["leaderPoint"][2]
                    )

                    mleader.MText = mtext
                    mleader.TextLocation = Point3d(
                        item["leaderPoint"][0], item["leaderPoint"][1], item["leaderPoint"][2]
                    )
                    mleader.AddLeaderLine(Point3d(item["rimPoint"][0], item["rimPoint"][1], item["rimPoint"][2]))

                    model_space.AppendEntity(mleader)
                    tr.AddNewlyCreatedDBObject(mleader, True)
                    created_count += 1

                tr.Commit()
            finally:
                tr.Dispose()
                lock_doc.Dispose()
        except Exception as ex:
            errors.append("Leader creation failed: {0}".format(ex))

    OUT = (summary, created_count, errors)
# ----------------------------------------
code_block_4 = CodeBlock { 0; 1; 2; }
leader_count_1 = List.GetItemAtIndex(index=code_block_4.out1)  # unwired: list
watch_3 = Watch(leader_count_1)
errors_2 = List.GetItemAtIndex(index=code_block_4.out2)  # unwired: list
watch_4 = Watch(errors_2)
string_6 = StringInput("Unclassified")
valueAtKey_2 = DesignScript.Builtin.Dictionary.ValueAtKey(dictionary=userDefinedProperties@L1, key=string_6)
with_direction = Python(IN[0]=byCoordinates, IN[1]=elevation_2, IN[2]=byCoordinates_2, IN[3]=valueAtKey, IN[4]=code_block_2, IN[5]=code_block_3.out0, IN[6]=code_block_3.out0, IN[7]=code_block_3.out2, IN[8]=code_block_3.out3, IN[9]=boolean, IN[10]=valueAtKey_2)  # CPython3
# ---------- with_direction.python (268 lines) ----------
"""Dynamo Python helper for HomeINV.

Inputs
IN[0] rim points: DesignScript points or Civil COGO points
IN[1] rim elevations: list[double]
IN[2] invert points: DesignScript points or Civil COGO points
IN[3] invert values: either depth values or UDP dictionaries
IN[4] UDP key: default "INVERT"
IN[5] leader dx: default 5.0
IN[6] leader dy: default 5.0
IN[7] text height: default 1.0
IN[8] precision: default 2
IN[9] create leaders: default False
IN[10] invert directions: optional list like ["N", "S", "E", "W"]

Outputs
OUT[0] summary per rim
OUT[1] created multileader count
OUT[2] errors
"""

import math


def _flatten(value):
    if isinstance(value, (list, tuple)):
        out = []
        for item in value:
            out.extend(_flatten(item))
        return out
    return [value]


def _as_list(value):
    if value is None:
        return []
    if isinstance(value, (list, tuple)):
        return list(value)
    return [value]


def _maybe_float(value):
    if value is None:
        return None
    if isinstance(value, bool):
        return float(value)
    if isinstance(value, (int, float)):
        return float(value)
    if isinstance(value, str):
        cleaned = value.strip()
        if not cleaned:
            return None
        filtered = "".join(ch for ch in cleaned if ch in "0123456789.-")
        if filtered in ("", "-", ".", "-."):
            return None
        try:
            return float(filtered)
        except Exception:
            return None
    return None


def _dict_value(item, key):
    if item is None:
        return None
    if isinstance(item, dict):
        return item.get(key)
    if hasattr(item, "ValueAtKey"):
        try:
            return item.ValueAtKey(key)
        except Exception:
            pass
    if hasattr(item, "__getitem__"):
        try:
            return item[key]
        except Exception:
            pass
    return item


def _extract_depth(item, key):
    value = _dict_value(item, key)
    flat = _flatten(value)
    for candidate in flat:
        number = _maybe_float(candidate)
        if number is not None:
            return number
    return None


def _extract_direction(item):
    flat = _flatten(item)
    for candidate in flat:
        if candidate is None:
            continue
        text = str(candidate).strip().upper()
        if text in ("N", "S", "E", "W"):
            return text
    return None


def _point_xyz(item):
    if item is None:
        return None
    if all(hasattr(item, axis) for axis in ("X", "Y")):
        z = getattr(item, "Z", 0.0)
        return (float(item.X), float(item.Y), float(z))
    if all(hasattr(item, axis) for axis in ("Easting", "Northing")):
        z = getattr(item, "Elevation", 0.0)
        return (float(item.Easting), float(item.Northing), float(z))
    if hasattr(item, "PointGeometry"):
        geom = item.PointGeometry
        if geom and all(hasattr(geom, axis) for axis in ("X", "Y")):
            z = getattr(geom, "Z", 0.0)
            return (float(geom.X), float(geom.Y), float(z))
    return None


def _format_number(value, precision):
    return ("{0:." + str(int(precision)) + "f}").format(float(value))


def _build_text(rim_elev, invert_items, precision):
    lines = ["RIM=" + _format_number(rim_elev, precision)]
    ordered_items = sorted(invert_items, key=lambda item: item["elevation"], reverse=True)
    for item in ordered_items:
        line = "INV= " + _format_number(item["elevation"], precision)
        if item["direction"]:
            line += " (" + item["direction"] + ")"
        lines.append(line)
    return lines


def _distance_xy(a, b):
    dx = a[0] - b[0]
    dy = a[1] - b[1]
    return dx * dx + dy * dy


rim_points = _as_list(IN[0] if len(IN) > 0 else None)
rim_elevs = _as_list(IN[1] if len(IN) > 1 else None)
invert_points = _as_list(IN[2] if len(IN) > 2 else None)
invert_values = _as_list(IN[3] if len(IN) > 3 else None)
udp_key = IN[4] if len(IN) > 4 and IN[4] else "INVERT"
leader_dx = float(IN[5]) if len(IN) > 5 and IN[5] is not None else 5.0
leader_dy = float(IN[6]) if len(IN) > 6 and IN[6] is not None else 5.0
text_height = float(IN[7]) if len(IN) > 7 and IN[7] is not None else 1.0
precision = int(IN[8]) if len(IN) > 8 and IN[8] is not None else 2
create_leaders = bool(IN[9]) if len(IN) > 9 else False
invert_directions = _as_list(IN[10] if len(IN) > 10 else None)

errors = []
rim_data = []

for idx, rim in enumerate(rim_points):
    xyz = _point_xyz(rim)
    elev = rim_elevs[idx] if idx < len(rim_elevs) else None
    elev = _maybe_float(elev if elev is not None else (xyz[2] if xyz else None))
    if xyz is None or elev is None:
        errors.append("Skipped rim index {0}: missing point or elevation.".format(idx))
        continue
    rim_data.append(
        {
            "index": idx,
            "xyz": xyz,
            "elev": elev,
            "invertItems": [],
        }
    )

if not rim_data:
    OUT = ([], 0, errors + ["No valid rim points were supplied."])
else:
    for idx, inv_point in enumerate(invert_points):
        inv_xyz = _point_xyz(inv_point)
        depth_source = invert_values[idx] if idx < len(invert_values) else None
        direction_source = invert_directions[idx] if idx < len(invert_directions) else None
        depth = _extract_depth(depth_source, udp_key)
        direction = _extract_direction(direction_source)
        if inv_xyz is None or depth is None:
            errors.append("Skipped invert index {0}: missing point or {1} value.".format(idx, udp_key))
            continue
        nearest = min(rim_data, key=lambda rim: _distance_xy(inv_xyz, rim["xyz"]))
        nearest["invertItems"].append(
            {
                "elevation": nearest["elev"] - depth,
                "direction": direction,
            }
        )

    summary = []
    for rim in rim_data:
        ordered_items = sorted(rim["invertItems"], key=lambda item: item["elevation"], reverse=True)
        lines = _build_text(rim["elev"], ordered_items, precision)
        summary.append(
            {
                "rimPoint": rim["xyz"],
                "rimElevation": rim["elev"],
                "invertElevations": [item["elevation"] for item in ordered_items],
                "invertDirections": [item["direction"] for item in ordered_items],
                "invertLabels": [
                    "INV= "
                    + _format_number(item["elevation"], precision)
                    + (" (" + item["direction"] + ")" if item["direction"] else "")
                    for item in ordered_items
                ],
                "textLines": lines,
                "mtextContents": "\\P".join(lines),
                "leaderPoint": (rim["xyz"][0] + leader_dx, rim["xyz"][1] + leader_dy, rim["xyz"][2]),
            }
        )

    created_count = 0

    if create_leaders:
        try:
            import clr

            for assembly_name in ("AcMgd", "AcDbMgd", "AcCoreMgd"):
                try:
                    clr.AddReference(assembly_name)
                except Exception:
                    pass

            from Autodesk.AutoCAD.ApplicationServices import Application
            from Autodesk.AutoCAD.DatabaseServices import BlockTableRecord, ContentType, MLeader, MText, OpenMode
            from Autodesk.AutoCAD.Geometry import Point3d

            doc = Application.DocumentManager.MdiActiveDocument
            db = doc.Database
            lock_doc = doc.LockDocument()
            tr = db.TransactionManager.StartTransaction()

            try:
                block_table = tr.GetObject(db.BlockTableId, OpenMode.ForRead)
                model_space = tr.GetObject(block_table[BlockTableRecord.ModelSpace], OpenMode.ForWrite)

                for item in summary:
                    mleader = MLeader()
                    mleader.SetDatabaseDefaults()
                    mleader.ContentType = ContentType.MTextContent

                    mtext = MText()
                    mtext.SetDatabaseDefaults()
                    mtext.TextHeight = text_height
                    mtext.Contents = item["mtextContents"]
                    mtext.Location = Point3d(
                        item["leaderPoint"][0], item["leaderPoint"][1], item["leaderPoint"][2]
                    )

                    mleader.MText = mtext
                    mleader.TextLocation = Point3d(
                        item["leaderPoint"][0], item["leaderPoint"][1], item["leaderPoint"][2]
                    )
                    mleader.AddLeaderLine(Point3d(item["rimPoint"][0], item["rimPoint"][1], item["rimPoint"][2]))

                    model_space.AppendEntity(mleader)
                    tr.AddNewlyCreatedDBObject(mleader, True)
                    created_count += 1

                tr.Commit()
            finally:
                tr.Dispose()
                lock_doc.Dispose()
        except Exception as ex:
            errors.append("Leader creation failed: {0}".format(ex))

    OUT = (summary, created_count, errors)
# ----------------------------------------
SUMMARY = List.GetItemAtIndex(list=with_direction, index=code_block_4.out0)
watch_5 = Watch(SUMMARY)
string_7 = StringInput("mtextContents")
valueAtKey_3 = DesignScript.Builtin.Dictionary.ValueAtKey(dictionary=watch_5, key=string_7)
watch_6 = Watch(valueAtKey_3)
string_8 = StringInput("leaderPoint")
valueAtKey_4 = DesignScript.Builtin.Dictionary.ValueAtKey(dictionary=watch_5, key=string_8)
transpose = List.Transpose(lists=valueAtKey_4)
getItemAtIndex = List.GetItemAtIndex(list=transpose, index=code_block_4.out0)
getItemAtIndex_2 = List.GetItemAtIndex(list=transpose, index=code_block_4.out1)
getItemAtIndex_3 = List.GetItemAtIndex(list=transpose, index=code_block_4.out2)
byCoordinates_3 = Point.ByCoordinates(x=getItemAtIndex, y=getItemAtIndex_2, z=getItemAtIndex_3)
watch_7 = Watch(byCoordinates_3)
string_9 = StringInput("rimPoint")
valueAtKey_5 = DesignScript.Builtin.Dictionary.ValueAtKey(dictionary=watch_5, key=string_9)
transpose_2 = List.Transpose(lists=valueAtKey_5)
getItemAtIndex_4 = List.GetItemAtIndex(list=transpose_2, index=code_block_4.out0)
getItemAtIndex_5 = List.GetItemAtIndex(list=transpose_2, index=code_block_4.out1)
getItemAtIndex_6 = List.GetItemAtIndex(list=transpose_2, index=code_block_4.out2)
byCoordinates_4 = Point.ByCoordinates(x=getItemAtIndex_4, y=getItemAtIndex_5, z=getItemAtIndex_6)
choose_multileader_style = ListMultileaderStyle("Standard", ItemList=["Standard"])
byPointsText = Autodesk.AutoCAD.DynamoNodes.Multileader.ByPointsText(contents=valueAtKey_3, textLocation=byCoordinates_3, arrowheadLocations=byCoordinates_4, style=choose_multileader_style, lacing=Longest)
watch_8 = Watch(byPointsText)
keys_2 = DesignScript.Builtin.Dictionary.Keys()  # unwired: dictionary
values = DesignScript.Builtin.Dictionary.Values(dictionary=userDefinedProperties)
